vi "PreCheck Cells before measuring.gvi"   [LabVIEW NXG 3.1.0]
inputs:
  "Multiple acquire variables control": "Multiple acquire variables control.gtype" = {"Wavelength for peak detection"=500, "R.01 Reference Coordinates"={"X coordinate R.01"=145.3, "Z coordinate R.01"=2.5, "Vertical Spacing"=4.5}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}
  "Multiplexer arduino Log In": string
  "Error In": error
outputs:
  "Multiple acquire variables control out": "Multiple acquire variables control.gtype"
  "Multiplexer arduino log out": string
  "New Cell Measuring order": string
  "Error Out": error
  "Dead cells?": bool
panel controls:
  "Stand Alone Operation": bool
  "Current Threshold": f64 = 1e-09
panel indicators:
  "-10 mV Current": f64
  "Precheck Cells Data array": "Precheck Cells Data array.gtype"
types:
  T1 = cluster{"Cell Label": string, "-10mV Current": f64, "Dead?": bool}
  "Precheck Cells Data array.gtype" = T1[]
  "R.01 Reference Coordinates.gtype" = cluster{"X coordinate R.01": f64, "Z coordinate R.01": f64, "Vertical Spacing": f64}
  "Multiple acquire variables control.gtype" = cluster{"Monochromator configuration file ": path, "Light Power Calibration Data": f64[][], "Cell Measuring Labels": string[], "Sample Prefix": string, "Author Initials": string, "Current Date": string, "Batch Name": string, "Default Data Saving Location": path, "Filter Arduino Status": bool, "Filter Arduino Address": "VISA Instr", "Multiplexer Arduino Address": "VISA Instr", "Carriage Arduino Address": "VISA Instr", "Keithley Address": "VISA Instr", "Current Averages   ": f64, "Manual Range  ": f64, "Max current": f64, "Voltage Applied (V)  ": f64, "Autorange  ": bool, "Dark Current  ": bool, "Wavelength for peak detection": f64, "R.01 Reference Coordinates": "R.01 Reference Coordinates.gtype", "R.01 Scan?": bool, "Z scan steps": f64, "X scan Range (mm)": f64, "Z scan Range (mm)": f64, "X scan steps": f64, "Reference Coordinates file": path, "Save R.01 Coordinate?": bool, "Fianium Pe Handler": u64, "Automatic Measurement?": bool, "Dead Cell 10mV Current Threshold": f64, "Precheck cells?": bool}
uses:
  EQE_Measuring_Setup_NanOpto::SubVis::Instrument Control::Keithley::Keithley Initialization Sequence.gvi
  EQE_Measuring_Setup_NanOpto::SubVis::Instrument Control::Instrument detector.gvi
  EQE_Measuring_Setup_NanOpto::SubVis::Instrument Control::Arduinos::Arduino Detector.gvi
  EQE_Measuring_Setup_NanOpto::SubVis::FGV::Current State FGV.gvi
  EQE_Measuring_Setup_NanOpto::SubVis::Instrument Control::Arduinos::Multiplexer Arduino::Multiplexer Arduino Control.gvi
  EQE_Measuring_Setup_NanOpto::SubVis::Utilities::Other::Wait In line ms.gvi
  EQE_Measuring_Setup_NanOpto::SubVis::Main Sub Functions::Acquire::Multiple Acquire::Precheck measurement.gvi
  EQE_Measuring_Setup_NanOpto::SubVis::Main Sub Functions::Global Abort::Global Abort.gvi
  Keithley 2450 NXG Library::Public::Close.gvi
diagram:
  case ($"Stand Alone Operation") {
    frame False, Default {
      Property Node(instance in=$"Multiple acquire variables control") -> ("Current Averages   "=w6, "Multiplexer Arduino Address"=w2, "Cell Measuring Labels"=w3, "Dead Cell 10mV Current Threshold"=w4, "Autorange  "=w7, "Manual Range  "=w8, "Max current"=w9, "Keithley Address"=w10, instance out=w1)
      call "Keithley Initialization Sequence.gvi"(Enable Auto Range=w7, VISA resource name=w10, Voltage Applied (V)=-0.01, Source Limit Level (0.1)=w9, Current Averages=w6, Error In=$"Error In", Manual Current Range=w8) -> (Error Out=w5)
    }
    frame True {
      call "Instrument detector.gvi"(Instruments to Detect="Keythley", Error In=$"Error In") -> (Keithley Address=w11, Error Out=w12)
      Property Node(instance in=$"Multiple acquire variables control", "Max current"=0.05, "Current Averages   "=3, "Keithley Address"=w11) -> (instance out=w1)
      call "Keithley Initialization Sequence.gvi"(VISA resource name=w11, Voltage Applied (V)=-0.01, Source Limit Level (0.1)=0.05, Current Averages=3, Error In=w12) -> (Error Out=w13)
      call "Arduino Detector.gvi"(Error In=w13) -> (Multiplexer Arduino Address=w2, Error Out=w5)
      w3 = ["L.03"]
      w4 = $"Current Threshold"
    }
  }
  Property Node(instance in=w1) -> (instance out=w14)
  $"Multiple acquire variables control out" <- w14
  case (w5) {
    frame Error, Default {
      w15 = w5
    }
    frame No Error {
      call "Current State FGV.gvi"(Instruction Current State FGV="Set Current SubState", Current SubState="Prechecking Cells", Error In=w5) -> (Error Out=w16)
      s1 = $"Multiplexer arduino Log In"  # shift register
      s2 = "Precheck Cells Data array.gtype" []  # shift register
      for (iteration -> i1) {
        w17 = each element of w3
        call "Multiplexer Arduino Control.gvi"(Arduino Multiplexer Address In=w2, Cell Label=w17, Error In=w16) -> (Arduino Multiplexer Log=w19, Error Out=w20)
        Concatenate Strings(s1, w19) -> w21
        call "Wait In line ms.gvi"(Error In=w20, milliseconds to wait=200) -> (Error Out=w22)
        call "Precheck measurement.gvi"(Multiple acquire variables control=w1, Error In=w22, Close Coms after finish?=FALSE) -> (Keythley address out=w23, -10mV current Value=w24, Error Out=w25)
        Absolute Value(x=w4) -> w26
        Absolute Value(x=w24) -> w27
        Is Less(x=w27, y=w26) -> w28
        Property Node(instance in=T1 {all zero or empty}, "Cell Label"=w17, "-10mV Current"=w24, "Dead?"=w28) -> (instance out=w29)
        Insert Into Array(inArray=s2, index0=i1, new=w29) -> w30
        $"-10 mV Current" <- w24
        call "Global Abort.gvi"(Instruction="Read Abort State", Error In=w25) -> (Local Abort State=w31, Global Abort State=w32, Error Out=w33)
        Logical Or(w33, w31, w32) -> w34
        append w28 to w18
        next s1 = w21
        next s2 = w30
        stop if w34
      }
      $"Multiplexer arduino log out" <- s1
      Or Array Elements(Boolean array=w18) -> (logical OR=w35)
      case (w35) {
        frame False, Default { }
        frame True {
          w36 = "The following cells are below the \nspecified threshold (dead)\nhence they will not be measured:"
          Concatenate Strings(w36, "\r\n", "\r\n") -> w37
          s3 = w37  # shift register
          s4 = ""  # shift register
          for (iteration -> i2) {
            w38 = each element of s2
            Property Node(instance in=w38) -> ("Cell Label"=w39, "-10mV Current"=w40, "Dead?"=w41)
            case (w41) {
              frame False, Default {
                w42 = s3
              }
              frame True {
                Number To Exponential String(number=w40, use system decimal point (T)=FALSE) -> (E-format string=w43)
                Concatenate Strings(s3, w39, " ", "Current: ", w43, " A", " ", "\r\n") -> w42
              }
            }
            Select(s=w41, t="†", f="") -> w44
            Increment(x=i2) -> w45
            Quotient And Remainder(x=w45, y=6) -> (x-y*floor(x/y)=w46)
            Is Equal To 0(x=w46) -> w47
            Select(s=w47, t="\r\n", f="") -> w48
            Concatenate Strings(s4, w39, w44, " -> ", w48) -> w49
            next s3 = w42
            next s4 = w49
          }
          w50 = "\nIf you consider they should be\nfunctional, try removing ang reinseting\nthe cell, or lowering the specified threshold."
          Concatenate Strings(s3, w50) -> w51
          One Button Dialog(button name ("OK")="Okay, I will consider it", message=w51)
          $"New Cell Measuring order" <- s4
        }
      }
      $"Precheck Cells Data array" <- s2
      call "Close.gvi"(VISA resource name=w23, error in (no error)=w33) -> (error out=w15)
      $"Dead cells?" <- w35
    }
  }
  $"Error Out" <- w15
