vi "Single EQE Measurement Acquire.gvi"   [LabVIEW NXG 3.1.0]
inputs:
  "Single acquire inputs control": "Single acquire inputs control.gtype"
  "Notifier In": Notifier<"Single Acquire Notification control.gtype">
  "Error In": error
outputs:
  "Error Out": error
  "Dark Current": f64
  "Full EQE Data": f64[][]
  "Notifier Out": Notifier<"Single Acquire Notification control.gtype">
panel indicators:
  "Current measurements": f64[]
  "spreadsheet string": string
types:
  "Single acquire inputs control.gtype" = cluster{"Light calibration data": f64[][], "Fiannium Configuration File": path, "Arduino Filter Flipper Address": "VISA Instr", "Filter Arduino Status": bool, "Dark Current Averages": f64, "Measure dark current?": bool, "Keithley Address": "VISA Instr", "Current Aveages": i32, "Voltage Applied (V)": f64, "Max current compliance": f64, "Manual Current Range": f64, "Enable Auto Range": bool, "Automatic measurement": bool, "Fiannium Pe Handler": u64, "Dead Cell? Current Threshold": f64, "Automatic measurement Cell Dark current": f64}
  "Single Acquire Notification control.gtype" = cluster{"Wavelength (nm)": f64, "EQE (%)": f64, "Current (A)": f64, "Finnished": bool, "Progress": f64}
uses:
  EQE_Measuring_Setup_NanOpto::SubVis::Instrument Control::Keithley::Keithley Initialization Sequence.gvi
  PE_Filter_SDK::Monochromator Initialization Sequence.gvi
  EQE_Measuring_Setup_NanOpto::SubVis::FGV::Current State FGV.gvi
  EQE_Measuring_Setup_NanOpto::SubVis::Instrument Control::Arduinos::Filter Flipper Arduino::Filter Plipper Arduino set to IR pass.gvi
  EQE_Measuring_Setup_NanOpto::SubVis::Instrument Control::Keithley::Dark current Measurement.gvi
  Keithley 2450 NXG Library::Public::Configure::Set Measurement Count.gvi
  EQE_Measuring_Setup_NanOpto::SubVis::Utilities::Other::Light Calibration parameters extractor.gvi
  EQE_Measuring_Setup_NanOpto::SubVis::Instrument Control::Monochromator::Filter Wavelength nm Crossing ka.gvi
  EQE_Measuring_Setup_NanOpto::SubVis::Utilities::Other::Wavelength loop calculation.gvi
  Keithley 2450 NXG Library::Public::Configure::Configure Measurement Range.gvi
  EQE_Measuring_Setup_NanOpto::SubVis::Instrument Control::Arduinos::Filter Flipper Arduino::Filter Flipper arduino flip subroutine.gvi
  Keithley 2450 NXG Library::Public::Configure::Clear Buffer.gvi
  Keithley 2450 NXG Library::Public::Configure::Configure Integration Filter.gvi
  Keithley 2450 NXG Library::Public::Action Status::Enable Output.gvi
  EQE_Measuring_Setup_NanOpto::SubVis::Instrument Control::Monochromator::Fiannium wavelength correction.gvi
  EQE_Measuring_Setup_NanOpto::SubVis::Utilities::Other::Wavelength detection filter flipper routine.gvi
  PE_Filter_SDK::PE Set Wavelength On Grating.gvi
  EQE_Measuring_Setup_NanOpto::SubVis::Main Sub Functions::Global Abort::Global Abort.gvi
  EQE_Measuring_Setup_NanOpto::SubVis::FGV::Skip To next Cell FGV.gvi
  Keithley 2450 NXG Library::Public::Data::Make Reading and Store in Buffer.gvi
  Keithley 2450 NXG Library::Public::Data::Read (Multiple Points).gvi
  NI::Analysis::Statistics::Mean (DBL).gvi
  EQE_Measuring_Setup_NanOpto::SubVis::Utilities::Messages And Prompts::Erase Notification Error.gvi
  Keithley 2450 NXG Library::Public::Close.gvi
  PE_Filter_SDK::PE Close.gvi
  PE_Filter_SDK::PE Destroy.gvi
diagram:
  Property Node(instance in=$"Single acquire inputs control") -> ("Enable Auto Range"=w1, "Fiannium Configuration File"=w2, "Arduino Filter Flipper Address"=w3, "Filter Arduino Status"=w4, "Dark Current Averages"=w5, "Measure dark current?"=w6, "Keithley Address"=w7, "Current Aveages"=w8, "Voltage Applied (V)"=w9, "Max current compliance"=w10, "Manual Current Range"=w11, "Automatic measurement"=w12, "Fiannium Pe Handler"=w13)
  Logical And(not w12, w6) -> w14
  case (w12) {
    frame True {
      # If it is an automatic measurement
      # both the keithley and the fiannium will have been
      # initialized
      w15 = w7
      w16 = w13
      w17 = $"Error In"
    }
    frame False {
      call "Keithley Initialization Sequence.gvi"(Enable Auto Range=w1, VISA resource name=w7, Voltage Applied (V)=w9, Source Limit Level (0.1)=w10, Current Averages=w8, Error In=$"Error In", Manual Current Range=w11) -> (VISA resource name out=w15, Error Out=w18)
      call "Monochromator Initialization Sequence.gvi"(Configuration File=w2, Error In=w18) -> (peHandle out=w16, Error Out=w17)
    }
  }
  case (w14) {
    frame False, Default {
      # If It is an automatic measurement or we do not want
      # to measure the dark current we just pass the info
      w19 = w15
      w20 = w17
      w21 = w16
    }
    frame True {
      call "Current State FGV.gvi"(Instruction Current State FGV="Set Current SubState", Current SubState="Measuring Dark Current", Error In=w17) -> (Error Out=w22)
      call "Filter Plipper Arduino set to IR pass.gvi"(Arduino Filter Flipper Address=w3, Filter Arduino Status=w4, Error In=w22) -> (Error Out=w23)
      call "Dark current Measurement.gvi"(Keithley Address=w15, Fiannium Pe Handler=w16, Close Coms after finish?=FALSE, Error In=w23, Dark Current Aveages=w5) -> (Dark current Value=w24, Pe Handle out=w21, Keythley address out=w25, Error Out=w26)
      $"Dark Current" <- w24
      call "Set Measurement Count.gvi"(VISA resource name=w25, Measurement Count=w8, error in (no error)=w26) -> (VISA resource name out=w19, error out=w20)
    }
  }
  case (w20) {
    frame Error, Default {
      w28 = "Single Acquire Notification control.gtype" {all zero or empty}
      Send Notification(notification=w28, notifier=$"Notifier In")
      w27 = w20
    }
    frame No Error {
      Property Node(instance in=$"Single acquire inputs control") -> ("Filter Arduino Status"=w29, "Arduino Filter Flipper Address"=w30, "Light calibration data"=w31, "Dead Cell? Current Threshold"=w32, "Enable Auto Range"=w33)
      call "Light Calibration parameters extractor.gvi"(Light calibration data=w31) -> (End Wavelength (nm) Current Calibration=w34, Wavelength Step (nm) Current Calibration=w35, Start Wavelength (nm) Current Calibration=w36)
      call "Filter Wavelength nm Crossing ka.gvi"(Light Power Calibration Data=w31) -> (Crosses the Change Grating Wavelength Frontier?=w37)
      call "Wavelength loop calculation.gvi"(Wavelength Step (nm)=w35, End Wavelength (nm)=w34, Start Wavelength (nm)=w36) -> (Ammount of steps +1 (for the loop)=w38, Positive or negative steps=w39, Exact ammount of steps=w40)
      call "Configure Measurement Range.gvi"(VISA resource name=w19, Function (0: Volts)="Current"(1), Enable Auto Range (T:Enable)=w33, error in (no error)=w20) -> (VISA resource name out=w41, error out=w42)
      call "Filter Flipper arduino flip subroutine.gvi"(Start Wavelength (nm) Current Calibration=w36, Filter Arduino Status=w29, Arduino Filter Flipper Address=w30, Error In=w42) -> (Error Out=w43)
      call "Clear Buffer.gvi"(VISA resource name=w41, error in (no error)=w43) -> (VISA resource name out=w44, error out=w45)
      call "Configure Integration Filter.gvi"(VISA resource name=w44, Measurement Speed (1 PLC)=0.5, error in (no error)=w45) -> (VISA resource name out=w46, error out=w47)
      call "Enable Output.gvi"(VISA resource name=w46, Enable Output (T: Enable)=TRUE, error in (no error)=w47) -> (VISA resource name out=w48, error out=w49)
      s1 = w49  # shift register
      s2 = w21  # shift register
      s3 = w48  # shift register
      s4 = f64[][] []  # shift register
      s5 = $"Notifier In"  # shift register
      s6 = uninitialised  # shift register
      s6.prev1 = uninitialised  # shift register
      s6.prev2 = uninitialised  # shift register
      for (N = w38) (iteration -> i1) {
        Wait Until Next Multiple(multiple to wait=5)
        # w50: Light power at current wavelength
        Property Node(instance in=$"Single acquire inputs control") -> ("Current Aveages"=w51, "Filter Arduino Status"=w52, "Arduino Filter Flipper Address"=w53)
        Multiply(i1, w51) -> w54
        Increment(x=w54) -> w55
        Add(w54, w51) -> w56
        call "Current State FGV.gvi"(Instruction Current State FGV="Set Current SubState", Current SubState="Measuring with Keithley", Error In=s1) -> (Error Out=w57)
        call "Keithley adaptative measurement setup.gvi"(Keithley address in=s3, Last Measurement=s6, 2nd Last Measurement=s6.prev1, 3nd Last Measurement=s6.prev2, threshold=w32, loop iteration=i1, Error Out=w57, Single acquire inputs control=$"Single acquire inputs control") -> (Keythley address out=w58, Error In=w59)
        Multiply(w35, i1, w39) -> w60
        Add(w60, w36) -> w61
        call "Fiannium wavelength correction.gvi"(Desired wavelength=w61) -> (Grating for the system=w62, Wavelength for the system=w63)
        call "Wavelength detection filter flipper routine.gvi"(Current Wavelength=w61, Arduino Filter Flipper Status=w52, Arduino Filter Flipper Address=w53, Crossing Ka=w37, Error In=w59) -> (Error Out=w64)
        call "PE Set Wavelength On Grating.gvi"(peHandle=s2, gratingIndex=w62, wavelength=w63, error in (no error)=w64) -> (peHandle out=w65, error out=w66)
        # w56: Buffer end index
        call "Global Abort.gvi"(Instruction="Read Abort State", Error In=w66) -> (Local Abort State=w67, Global Abort State=w68, Error Out=w69)
        # w55: Buffer start index
        call "Skip To next Cell FGV.gvi"(General instruction FGV enum="Read state", Error In=w69) -> (Skip cell? out=w70, Error Out=w71)
        call "Make Reading and Store in Buffer.gvi"(VISA resource name=w58, error in (no error)=w71) -> (VISA resource name out=w72, error out=w73)
        call "Read (Multiple Points).gvi"(VISA resource name=w72, Timeout (10000 ms)=30000, Start Index (1)=w55, End Index (1)=w56, error in (no error)=w73) -> (VISA resource name out=w74, Data out=w75, error out=w76)
        Spreadsheet String To Array(array type=f64[] [], delimiter=",", format string="%g", spreadsheet string=w75) -> (array=w77)
        $"Current measurements" <- w77
        $"spreadsheet string" <- w75
        call "Mean (DBL).gvi"(x=w77, error in=w76) -> (mean=w78, error out=w79)
        Divide(x=i1, y=w38) -> w80
        Multiply(w80, 100) -> w81
        Is Greater Or Equal(x=i1, y=w40) -> w82
        Logical Or(w67, w68, w70) -> w83
        Logical Or(w82, w83) -> w84
        Divide(x=1240, y=w61) -> w85
        Array Index(array=w31) -> (out0[i1, 1]=w50)
        Divide(x=w78, y=w50) -> w86
        Multiply(w86, w85, 100) -> w87
        Absolute Value(x=w87) -> w88
        w89 = "Single Acquire Notification control.gtype" {all zero or empty}
        Property Node(instance in=w89, "Wavelength (nm)"=w61, "EQE (%)"=w88, "Current (A)"=w78, "Finnished"=w84, "Progress"=w81) -> (instance out=w90)
        Send Notification(error in (no error)=w79, notification=w90, notifier=s5) -> (error out=w91, notifier out=w92)
        call "Erase Notification Error.gvi"(error out_2=w91) -> (Output=w93)
        # w88: EQE (%)
        # w78: Current (A)
        Build Array(w61, w88, w78) -> w94
        Insert Into Array(inArray=s4, index0=i1, new=w94) -> w95
        Absolute Value(x=w78) -> w96
        next s1 = w93
        next s2 = w65
        next s3 = w74
        next s4 = w95
        next s5 = w92
        next s6 = w96
        stop if w83
      }
      Property Node(instance in=$"Single acquire inputs control") -> ("Automatic measurement"=w97)
      call "Skip To next Cell FGV.gvi"(General instruction FGV enum="Reset State", Error In=s1) -> (Error Out=w98)
      call "Enable Output.gvi"(VISA resource name=s3, Enable Output (T: Enable)=FALSE, error in (no error)=w98) -> (VISA resource name out=w99, error out=w100)
      call "Clear Buffer.gvi"(VISA resource name=w99, error in (no error)=w100) -> (VISA resource name out=w101, error out=w102)
      case (w97) {
        frame True {
          # If it is an automatic measurement
          # we leave the keithley running
          # and also the monochromator
          w27 = w102
        }
        frame False {
          call "Close.gvi"(VISA resource name=w101, error in (no error)=w102) -> (error out=w103)
          call "PE Close.gvi"(peHandle=s2, error in (no error)=w103) -> (peHandle out=w104, error out=w105)
          call "PE Destroy.gvi"(peHandle=w104, error in (no error)=w105) -> (error out=w27)
        }
      }
      $"Notifier Out" <- s5
      $"Full EQE Data" <- s4
    }
  }
  $"Error Out" <- w27
